# Grasshopper definition analysisRecipe.gh (Grasshopper 0.9.76)
# plug-ins: Python Interpreter

python = PythonScript()  # -> analysisRecipe; inputs testPts: list of Point3d, vectors: list of Vector3d
# ---------- python: Python ----------
import sys
sys.path.append(r"C:\Users\Administrator\Documents\GitHub\honeybee-grasshopper")

from honeybeegrasshopper.radiance import analysisrecipe, sky

sk = sky.HBCertainIlluminanceLevelSky(200)
analysisRecipe = analysisrecipe.GridBasedAnalysisRecipe(sk, testPts, vectors)
# ---------- end python ----------
